# Grasshopper definition perlin_maze.gh (Grasshopper 1.0.7)
# plug-ins: Noise 4D, Parakeet, Shortest Walk in Gh, Kangaroo2 Components

radius = Slider(35, range=1..50)
u_count = Slider(17, range=1..30)
v_count = Slider(22, range=1..30)
perlin_time = Slider(4.77, range=0..10)
perlin_scale = Slider(6, range=0..10)
maze_seed = Slider(18, range=0..100)
start = Slider(1292, range=0..3000)
radius_of_tube = Slider(3, range=0..10)
point = Point(Point(0, 0, 6.729852585))
number_slider = Slider(165, range=0..200)
radius_2 = GetNumber(radius, AtLeast=1, AtMost=1, Maximum=1.797693135e+308, Minimum=-1.797693135e+308)
ucount = GetNumber(u_count, AtLeast=1, AtMost=1, Maximum=1.797693135e+308, Minimum=-1.797693135e+308)
vcount = GetNumber(v_count, AtLeast=1, AtMost=1, Maximum=1.797693135e+308, Minimum=-1.797693135e+308)
time = GetNumber(perlin_time, AtLeast=1, AtMost=1, Maximum=1.797693135e+308, Minimum=-1.797693135e+308)
scale = GetNumber(perlin_scale, AtLeast=1, AtMost=1, Maximum=1.797693135e+308, Minimum=-1.797693135e+308)
seed = GetNumber(maze_seed, AtLeast=1, AtMost=1, Maximum=1.797693135e+308, Minimum=-1.797693135e+308)
start_2 = GetNumber(start, AtLeast=1, AtMost=10000, Maximum=1.797693135e+308, Minimum=-1.797693135e+308)
tube = GetNumber(radius_of_tube, AtLeast=1, AtMost=1, Maximum=1.797693135e+308, Minimum=-1.797693135e+308)
mesh_sphere = MeshSphere(Base=point, Radius=radius_2, UCount=ucount, VCount=vcount)
division = Division(A=scale, B=number_slider)
subtraction = Subtraction(A=u_count, B=number_slider)
number_slider_2 = Slider(100, range=0..100)
absolute = Absolute(Value=subtraction)
deconstruct_mesh = DeconstructMesh(Mesh=mesh_sphere)  # -> Vertices, Faces, Colours, Normals
division_2 = Division(A=absolute, B=number_slider_2)
division_3 = Division(A=radius_2, B=number_slider_2)
perlinnoise = PerlinNoise(Values=deconstruct_mesh.Vertices, Time=time, Scale=division)
multiplication = Multiplication(A=deconstruct_mesh.Normals, B=perlinnoise)
division_4 = Division(A=tube, B=Slider(20, range=0..100))
multiplication_2 = Multiplication(A=Slider(15, range=0..100), B=multiplication)
colour = Colour(deconstruct_mesh.Normals)
move = Move(Geometry=deconstruct_mesh.Vertices, Motion=multiplication_2)  # -> Geometry, Transform
addition = Addition(A=division_2, B=division_3, C=division_4)
construct_mesh = ConstructMesh(Vertices=move.Geometry, Faces=deconstruct_mesh.Faces, Colours=colour)
division_5 = Division(A=addition, B=Slider(2, range=0..10))
maze = Maze(Mesh=construct_mesh, Seed=seed)
join_curves = JoinCurves(Curves=maze, Preserve=False)
explode = Explode(Curve=join_curves, Recursive=True)  # -> flatten(Segments), flatten(Vertices)
curve = Curve(explode.Segments)
boolean_toggle = BooleanToggle(True)
sort_list = SortList(Keys=curve, ValuesValuesA=curve)  # -> Keys, ValuesValuesA
list_item = ListItem(List=sort_list.ValuesValuesA, Index=start_2, Wrap=boolean_toggle)
list_item_2 = ListItem(List=sort_list.ValuesValuesA, Index="1", Wrap=boolean_toggle)
end_points = EndPoints(Curve=list_item)  # -> Start, End
end_points_2 = EndPoints(Curve=list_item_2)  # -> Start, End
line = Line(StartPoint=end_points_2.Start, EndPoint=end_points.End)
merge = Merge(Data2=sort_list.ValuesValuesA)  # -> flatten(Result)
shortest_walk = ShortestWalk(Curves=explode.Segments, WantedPath=line)  # -> ShortestWalk, Succession, Direction, Length
curvepoint = PointOnCurve(merge, parameter=0.5)
pt = ConstructPoint(XCoordinate=0, YCoordinate=0, ZCoordinate=0)
pull = PullPoint(Point=curvepoint, Geometry=pt, ClosestOnly=True)  # -> ClosestPoint, Distance
multipipe = MultiPipe(
    Curves=shortest_walk.ShortestWalk,
    NodeSize=division_5,
    EndOffset=1,
    StrutSize=Slider(0.412, range=0..2),
    Segment=0,
    KinkAngle=division_5,
    CubeFit=0,
    Caps=Slider(1, range=0..2))
bnd = Bounds(Numbers=pull.Distance)
explode_2 = Explode(Curve=shortest_walk.ShortestWalk, Recursive=True)  # -> Segments, Vertices
curve_closest_point = CurveClosestPoint(Point=explode.Vertices, Curve=shortest_walk.ShortestWalk)  # -> Point, Parameter, flatten(Distance)
deconstruct_mesh_2 = DeconstructMesh(Mesh=multipipe)  # -> Vertices, Faces, Colours, Normals
remap = RemapNumbers(Value=pull.Distance, Source=bnd, Target=Domain(0, 1))  # -> Mapped, Clipped
mesh = Mesh(construct_mesh)
gradient = Gradient(
    LowerLimit=0,
    UpperLimit=1,
    Parameter=remap.Mapped,
    stops=[0.1: RGB(236, 27, 60), 0.2: RGB(210, 0, 118), 0.3: RGB(103, 0, 120), 0.4: RGB(39, 72, 161), 0.5: RGB(1, 192, 229), 0.6: RGB(18, 178, 90), 0.7: RGB(79, 186, 8), 0.8: RGB(220, 237, 32), 0.9: RGB(247, 159, 20), 1: RGB(243, 57, 0)])
larger_than = LargerThan(FirstNumber="0", SecondNumber=curve_closest_point.Distance)  # -> LargerThan, OrEqualTo
bnd_2 = Bounds(Numbers=deconstruct_mesh_2.Vertices)
remap_2 = RemapNumbers(Value=deconstruct_mesh_2.Vertices, Source=bnd_2, Target=Domain(0, 1))  # -> Mapped, Clipped
c_script = CSharpScript(crv=merge, color=gradient)  # -> out, A; inputs crv: Curve, color: Color
# ---------- c_script: C# ----------
    var c = color.R + "," + color.G + "," + color.B;
    crv.SetUserString("color", c);
    A = crv;
# ---------- end c_script ----------
gradient_2 = Gradient(
    LowerLimit=0,
    UpperLimit=1,
    Parameter=remap_2.Mapped,
    stops=[0: RGB(234, 38, 0), 0.25: RGB(234, 126, 0), 0.5: RGB(254, 244, 84), 0.75: RGB(173, 203, 249), 1: RGB(75, 107, 169)])
dispatch = Dispatch(List=explode.Vertices, DispatchPattern=larger_than.OrEqualTo)  # -> ListA, ListB
scale_2 = Scale(Geometry=mesh, Center=Point(0, 0, 0), Factor=Slider(0.524, range=0..2))  # -> Geometry, Transform
length = Length(Curve=join_curves)  # disabled
medges = MeshEdges(Mesh=scale_2.Geometry)  # -> NakedEdges, InteriorEdges, NonManifoldEdges
construct_mesh_2 = ConstructMesh(Vertices=deconstruct_mesh_2.Vertices, Faces=deconstruct_mesh_2.Faces, Colours=gradient_2)
mass_addition = MassAddition(Input=length)  # -> Result, PartialResults; disabled
join = JoinCurves(Curves=medges.InteriorEdges, Preserve=False)

# ---- group: RH_OUT:mesh
mesh_2 = Mesh(flatten([scale_2.Geometry, construct_mesh_2]))

# ---- group: RH_OUT:edges
curve_2 = Curve(flatten(c_script.A))

# ---- group: RH_OUT:length
data = Data(shortest_walk.Length)

# ---- group: RH_OUT:curve
curve_3 = Curve(join)

# ----
point_2 = Point(dispatch.ListB)  # disabled
point_3 = Point(explode_2.Vertices)  # disabled

# ---- group: RH_OUT:len
data_2 = Data(mass_addition.Result)  # disabled
